# Dynamo custom node GIS2BIM_ImportImageInView.dyf (Dynamo 2.10.1.3976)
# category: GIS2BIM.Image
# Import rasterimage in view
# packages: Clockwork for Dynamo 2.x 2.3.0

ImageWidthMeters = Input(ImageWidthMeters: double)
View = Input(View: var[]..[])
ImagePath = Input(ImagePath: var[]..[])
string = StringInput("\")
split = String.Split(str=ImagePath, separator0=string)
lastItem = List.LastItem(list=split)
duplicate = Custom[View.Duplicate](view=View, name=lastItem)  # package Clockwork for Dynamo 2.x; Duplicates a given view
DeltaX = Input(DeltaX: double = 0)  # mm
DeltaY = Input(DeltaY: double = 0)  # mm
code_block = CodeBlock { 300; }
boolean = BoolSelector(true)  # graph input
python_script = Python(IN[0]=ImageWidthMeters, IN[1]=duplicate, IN[2]=ImagePath, IN[3]=DeltaX, IN[4]=DeltaY, IN[5]=code_block, IN[6]=boolean)  # IronPython2
# ---------- python_script.python (114 lines) ----------
# Main part used from Konrad K Sobon

import clr
clr.AddReference('ProtoGeometry')
from Autodesk.DesignScript.Geometry import *
#The inputs to this node will be stored as a list in the IN variables.

clr.AddReference("RevitServices")
import RevitServices
from RevitServices.Persistence import DocumentManager
from RevitServices.Transactions import TransactionManager

clr.AddReference("RevitAPI")
import Autodesk 
from Autodesk.Revit.DB import * 
import System

# Import Element wrapper extension methods
clr.AddReference("RevitNodes")
import Revit
clr.ImportExtensions(Revit.Elements)

# Import geometry conversion extension methods
clr.ImportExtensions(Revit.GeometryConversion)

# Import DocumentManager and TransactionManager
clr.AddReference("RevitServices")
import RevitServices
from RevitServices.Persistence import DocumentManager
from RevitServices.Transactions import TransactionManager

doc = DocumentManager.Instance.CurrentDBDocument
uiapp = DocumentManager.Instance.CurrentUIApplication
app = uiapp.Application
intVersion = int(app.VersionNumber)

dataEnteringNode = IN

ImageWidthM=IN[0]
view=UnwrapElement(IN[1])
filePath=IN[2]
deltax=IN[3]
deltay=IN[4]
res = IN[5]
RunIt = IN[6]

width = ImageWidthM/0.3048
placement=System.Enum.GetValues(BoxPlacement)[0]
x = deltax/304.8
y = deltay/304.8
refPt = XYZ(x,y,0)

#Set Image Import Options

if intVersion > 2020:
	iio = ImagePlacementOptions()
		
	message = None
	if placement != None:
		iio.PlacementPoint = placement
	if refPt !=None:
		iio.Location = refPt
	else: 
		message = "Please specify placement point."
#	if res !=None:
#		iio.Resolution = res
#	else:
#		iio.Resolution = 72
else:
	iio= ImageImportOptions()
		
	message = None
	if placement != None:
		iio.Placement = placement
	if refPt !=None:
		iio.RefPoint = refPt
	else: 
		message = "Please specify placement point."
	if res !=None:
		iio.Resolution = res
	else:
		iio.Resolution = 72

if RunIt:
	# Start Transaction
	doc = DocumentManager.Instance.CurrentDBDocument
	TransactionManager.Instance.EnsureInTransaction(doc)

	newElement = clr.StrongBox[Element]()
	if intVersion > 2020:
		p = ModelPathUtils.ConvertUserVisiblePathToModelPath(filePath)
		ref = ExternalResourceReference.CreateLocalResource(doc,ExternalResourceTypes.BuiltInExternalResourceTypes.Image, p, PathType.Absolute);
		elementOut = ImageInstance.Create(doc,view,ImageType.Create(doc, ImageTypeOptions(ref,ImageTypeSource.Link)).Id,iio)
	else:
		elementOut = doc.Import(file = filePath, options = iio, view = view, element = newElement)
	
	#End Transaction
	TransactionManager.Instance.TransactionTaskDone()
	message = "Succes"
else: 
	message = "Set Runit to true"


#newElementID = newElement.Id

img = elementOut#UnwrapElement(newElement)
w = img.LookupParameter("Width")
TransactionManager.Instance.EnsureInTransaction(doc)
w.Set(width)
TransactionManager.Instance.TransactionTaskDone()

newElement = img.Name#newElement.Name

OUT = iio,message, newElement
# ----------------------------------------
Output = Output(python_script)  # ""
